# Grasshopper definition Sound2Haptic Parametric Script.gh (Grasshopper 1.0.8)

# ----
# Actuator Array Parameters:
number_of_rows = Slider(1, range=1..10)
inter_motor_spacing_in_x_axis = Slider(0.8125, range=0.8125..2)
inter_motor_spacing_in_y_axis = Slider(0.9875, range=0.8125..2)
strap_length = Slider(4.4153, range=0.8125..8)
number_of_motors = Slider(6, range=0..8)
height_of_corner_rings = Slider(0.067, range=0..1)
height_in_inches = Slider(0.154, range=0..1)

line_defining_length_of_each_ring_x_dire = Line(Line((23.08555049, 2.755906458, -0.1569133631), (23.91389534, 2.755906458, -0.1569133631)))  # "Line defining length of each ring X direction"
line_defining_length_of_each_ring_y_dire = Line(Line((28.64285317, 15.13588743, -0.002913363109), (28.64280803, 16.12618389, -0.002913363109)))  # "Line defining length of each ring y direction"
strap = SubD(<subd referenced from the Rhino model>)
hook = SubD(<subd referenced from the Rhino model>)
left_end_outer_ring_curves = Curve([<curve referenced from the Rhino model> x2])
right_side_outer_motor_ring_curves = Curve([<curve referenced from the Rhino model> x2])
number = Number(4.25)
panel = Panel(line_defining_length_of_each_ring_y_dire)
number_2 = Number(-6)
extract_length = Length(Curve=line_defining_length_of_each_ring_x_dire)
inside_outer_ring_curves = Curve([<curve referenced from the Rhino model> x3])
number_3 = Number(-2)
number_4 = Number(-2)
division = Division(A=strap_length, B=number)
addition = Addition(A=number_of_motors, B=number_2)
scale_nu = ScaleNU(
    Geometry=strap,
    Plane=Plane(origin=(22.31281805, 2.759186441, -0.09571258139), x=(0.0002066862979, -0.999887759, 0.01498087806), y=(0.9999999786, 0.0002066631036, -3.096342291e-06)),
    ScaleX=1,
    ScaleY=division,
    ScaleZ=1)  # -> Geometry, Transform
adjusting_number_slider = Addition(A=number_of_motors, B=number_4)
multiplication = Multiplication(A=extract_length, B=addition)
adjusting_num_of_motors = Addition(A=number_of_motors, B=number_3)
turn_into_x_vector = UnitX(Factor=extract_length)
turn_into_x_vector_2 = UnitX(Factor=multiplication)
multiply_number_slider_by_length = Multiplication(A=turn_into_x_vector, B=adjusting_number_slider)
move_to_right_end = Move(Geometry=right_side_outer_motor_ring_curves, Motion=multiply_number_slider_by_length)  # -> Geometry, Transform
array_of_motor_rings = LinearArray(Geometry=inside_outer_ring_curves, Direction=turn_into_x_vector, Count=adjusting_num_of_motors)  # -> Geometry, Transform
move = Move(Geometry=hook, Motion=turn_into_x_vector_2)  # -> Geometry, Transform
boolean = Boolean(True)
merge = Merge(Data1=array_of_motor_rings.Geometry, Data2=move_to_right_end.Geometry, Data3=left_end_outer_ring_curves)
flatten_tree = FlattenTree(Tree=merge, Path="{0}")
unit_z = UnitZ(Factor=1)
unit_y = UnitY(Factor=1)
number_5 = Number(2)
join_curves = JoinCurves(Curves=flatten_tree, Preserve=boolean)
multiplication_2 = Multiplication(A=unit_y, B=number_5)
multiplication_3 = Multiplication(A=unit_z, B=height_in_inches)
# Extracting the edges with the highest z position to fillet
outer_corner_rings = Curve([<curve referenced from the Rhino model> x4])
inner_corner_rings = Curve([<curve referenced from the Rhino model> x4])
move_2 = Move(Geometry=join_curves, Motion=multiplication_2)  # -> Geometry, Transform
unit_x = UnitX(Factor=line_defining_length_of_each_ring_x_dire)
boundary_surfaces = BoundarySurfaces(Edges=join_curves)
curve = Curve(move_2.Geometry)
duplicate_end_ring = DuplicateContent(Content=boundary_surfaces)
extrude = Extrude(Base=boundary_surfaces, Direction=multiplication_3)
unit_z_2 = UnitZ(Factor=height_in_inches)
move_3 = Move(Geometry=duplicate_end_ring, Motion=unit_z_2)  # -> Geometry, Transform
array_of_corner_loops = LinearArray(Geometry=outer_corner_rings, Direction=unit_x, Count=number_of_motors)  # -> Geometry, Transform
array_of_corner_loops_2 = LinearArray(Geometry=inner_corner_rings, Direction=unit_x, Count=number_of_motors)  # -> Geometry, Transform
unit_z_3 = UnitZ(Factor=height_of_corner_rings)
merge_2 = Merge(Data1=move_3.Geometry, Data2=extrude)
join_ends_main_frame = BrepJoin(Breps=merge_2)  # -> Breps, Closed
unit_z_4 = UnitZ(Factor=height_of_corner_rings)
boundary_surfaces_2 = BoundarySurfaces(Edges=array_of_corner_loops.Geometry)
boundary_surfaces_3 = BoundarySurfaces(Edges=array_of_corner_loops_2.Geometry)
getting_only_the_brep = ListItem(List=join_ends_main_frame.Breps, Index=1, Wrap=True)
deconstruct_brep = DeconstructBrep(Brep=getting_only_the_brep)  # -> Faces, Edges, Vertices
panel_2 = Panel(join_ends_main_frame.Breps)
extrude_2 = Extrude(Base=boundary_surfaces_2, Direction=unit_z_4)
extrude_3 = Extrude(Base=boundary_surfaces_3, Direction=unit_z_3)
curve_middle = CurveMiddle(Curve=deconstruct_brep.Edges)
list_length = ListLength(List=deconstruct_brep.Edges)
deconstruct = Deconstruct(Point=curve_middle)  # -> XComponent, YComponent, ZComponent
series = Series(Start=0, Step=1, Count=list_length)
# Scaling in the X direction
#  based on distance between
# motors parameter
solid_difference = SolidDifference(BrepsA=extrude_2, BrepsB=extrude_3)
sort_list = SortList(Keys=deconstruct.ZComponent, ValuesValuesA=series)  # -> Keys, ValuesValuesA
bounds = Bounds(Numbers=deconstruct.ZComponent)
number_6 = Number(2)
deconstruct_domain = DeconstructDomain(Domain=bounds)  # -> Start, End
fillet_radius = Slider(0.029, range=0..0.1)
unit_y_2 = UnitY(Factor=number_6)
length = Length(Curve=line_defining_length_of_each_ring_y_dire)
length_2 = Length(Curve=line_defining_length_of_each_ring_x_dire)
member_index = MemberIndex(Set=deconstruct.ZComponent, Member=deconstruct_domain.End)  # -> Index, Count
brep = Brep(scale_nu.Geometry)
number_7 = Number(length)
fillet_edge = FilletEdge(Shape=getting_only_the_brep, Blend=0, Metric=0, Edges=member_index.Index, Radii=fillet_radius)
number_8 = Number(length_2)
panel_3 = Panel(member_index.Index)
brep_2 = Brep(move.Geometry)
move_4 = Move(Geometry=solid_difference, Motion=unit_y_2)  # -> Geometry, Transform
division_2 = Division(A=inter_motor_spacing_in_y_axis, B=number_7)
number_9 = Number(2)
merge_3 = Merge(Data1=fillet_edge, Data2=brep_2, Data3=brep)
division_3 = Division(A=inter_motor_spacing_in_x_axis, B=number_8)
unit_y_3 = UnitY(Factor=1)
unit_x_2 = UnitX(Factor=1)
unit_y_4 = UnitY(Factor=1)
multiplication_4 = Multiplication(A=unit_y_3, B=number_9)
move_5 = Move(Geometry=merge_3, Motion=multiplication_4)  # -> Geometry, Transform
brep_3 = Brep(move_5.Geometry)
multiplication_5 = Multiplication(A=unit_y_4, B=division_2)
multiplication_6 = Multiplication(A=unit_x_2, B=division_3)
merge_4 = Merge(Data1=brep_3, Data2=move_4.Geometry)
solid_union = SolidUnion(Breps=merge_4)
scale_nu_2 = ScaleNU(
    Geometry=solid_union,
    Plane=PlaneXY(22.81520401, 4.837714669, 0),
    ScaleX=multiplication_6,
    ScaleY=multiplication_5,
    ScaleZ=1)  # -> Geometry, Transform
unit_y_5 = UnitY(Factor=line_defining_length_of_each_ring_y_dire)
number_10 = Number(2)
unit_y_6 = UnitY(Factor=number_10)
move_6 = Move(Geometry=scale_nu_2.Geometry, Motion=unit_y_6)  # -> Geometry, Transform
linear_array = LinearArray(Geometry=move_6.Geometry, Direction=multiplication_5, Count=number_of_rows)  # -> Geometry, Transform
brep_4 = Brep(linear_array.Geometry)
flatten_tree_2 = FlattenTree(Tree=brep_4, Path="{0}")
brep_join = BrepJoin(Breps=flatten_tree_2)  # -> Breps, Closed

# ----
# Final Node to “Bake”
solid_union_2 = SolidUnion(Breps=brep_join.Breps)
